# Dynamo graph BeamsByGrids.dyn (Dynamo 2.3.0.5885)

# group: 1. Get All the grids
categories = Categories("OST_GridHeads")
all_elements_of_category = ElementsOfCategory(Category=categories)
curve = Grid.Curve(grid=all_elements_of_category)

# group: 2. Get the Intersection points per Grid with other Grids
code_block = CodeBlock(l=curve) { 0..List.Count(l); }
shiftIndices = List.ShiftIndices(list=curve, amount=code_block)
deconstruct = List.Deconstruct(list=shiftIndices@L2)
code_block_2 = CodeBlock { 1; }
chop = List.Chop(list=deconstruct.first, lengths=code_block_2)
intersect = Geometry.Intersect(geometry=chop@L1, other=deconstruct.rest@L2)

# group: 3. Flatten them to Grid Level and create PolyCurves
flatten = List.Flatten(list=intersect@L3)
byPoints = PolyCurve.ByPoints(points=flatten)

# group: 4. Create Revit beams
curves = PolyCurve.Curves(polyCurve=byPoints)
levels = Levels("Level 1")
structural_framing_types = StructuralFramingTypes("UB305x165x40")
beamByCurve = StructuralFraming.BeamByCurve(curve=curves, level=levels, structuralFramingType=structural_framing_types)
